# Grasshopper definition volumen slicen.gh (Grasshopper 1.0.8)
# plug-ins: Human

pipeline = GeometryPipeline(
    GroupByLayer=False,
    GroupByType=False,
    IncludeHidden=False,
    IncludeLocked=True,
    LayerFilter="Entwurf*",
    NameFilter="geb",
    SublayerFiltering=True,
    TypeFilter=1073741848)

py3 = Python3Script(reset=Button())  # -> a
# ---------- py3: Python ----------
from compas_ghpython import unload_modules

unload_modules("jh_ghp_tools")

if reset:
    unload_modules("jh_ghp_tools")
# ---------- end py3 ----------

py3_2 = Python3Script(B=pipeline, h_eg="4", h_og="3.0", h_tot="40")  # -> C, A, T; inputs B: list of Brep, h_eg: Double, h_og: Double, h_tot: Double
# ---------- py3_2: Python ----------
from jh_ghp_tools import volumen_slicen
import ghpythonlib.components as gh


C, A, T = volumen_slicen(B, h_eg, h_og, h_tot)
# ---------- end py3_2 ----------
panel = Panel("soll 4029 m²")
panel_2 = Panel(py3_2.A)
crv = Curve(py3_2.C)
pt = Point(Point(111.2760423, 44.77935742, 0))
panel_3 = Panel(py3_2.T)
previewlw = CustomPreviewLineweights(Geometry=crv, Shader=ColourSwatch(SwatchColor=RGB(0, 0, 0)), Absolute=False)
tag = TextTag3D(Location=pt, Text=py3_2.A, Size="2", Colour=ColourSwatch(SwatchColor=RGB(0, 0, 0)), Justification=5)
